# Grasshopper definition 1007.gh (Grasshopper 1.0.7)

geodesics_in_u = Curve([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])
srf = Surface(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)
geodesics_in_v = Curve([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])
ccx = CurveCurve(CurveA=graft(geodesics_in_v), CurveB=geodesics_in_u)  # -> simplify(Points), ParamsA, ParamsB
trim = TrimTree(Tree=ccx.Points, Depth=1)
